# Dynamo graph CreateCorridorFromAlignment.dyn (Dynamo 2.17.0.3598)
# author: Civil3D AI Connector
# Creates a Civil 3D corridor from a named alignment, profile, and assembly. Inputs: Alignment Name, Profile Name, Assembly Name. Output: Corridor object.
# packages: Civil3DToolkitForDynamo 1.1.0.0

# group: INPUTS
# Alignment, Profile, Assembly names and corridor parameters
string_alignment_name = StringInput("Alignment-1")  # graph input
string_profile_name = StringInput("Design Profile")  # graph input
string_assembly_name = StringInput("Standard Assembly")  # graph input
string_corridor_name = StringInput("Corridor-1")  # graph input
number_start_station = DoubleInput(0)  # graph input
number_sample_spacing = DoubleInput(5)  # graph input

# group: CIVIL 3D OBJECT RETRIEVAL
# Fetch alignment, profile and assembly from drawing
get_alignment_by_name = CodeBlock { Civil3D.CivilDocument.GetAlignmentByName(doc, alignmentName); }  # unwired: doc, alignmentName
get_profile_by_name = CodeBlock { alignment.GetProfileByName(profileName); }  # unwired: alignment, profileName
get_assembly_by_name = CodeBlock { Civil3D.CivilDocument.GetAssemblyByName(doc, assemblyName); }  # unwired: doc, assemblyName
active_document = CodeBlock { Civil3D.CivilDocument.ActiveDocument; }

# group: CORRIDOR CREATION
# Python node: creates corridor, baseline, region and rebuilds
create_corridor_python = PythonNode()  # CPython3; unwired: IN[0], IN[1], IN[2], IN[3], IN[4], IN[5]

# group: OUTPUTS
# Corridor object and status message
corridor_output = CodeBlock { result[0]; }  # graph output; unwired: result
status_output = CodeBlock { result[1]; }  # graph output; unwired: result
